# Grasshopper definition sisu_gh.gh (Grasshopper 1.0.7)

python = GhPythonScript(
    sisufile="/Volumes/UNIT4/#TOOLBOX/SISU/sisufile_a101_full.json",
    layer_filter="^~",
    layer_exist=Toggle(True),
    render_layer_full_path=Toggle(True))  # -> out, dimension, layers, render_layers; inputs layer_exist: Boolean
# ---------- python: Python ----------
__author__ = "tmshv"

import rhinoscriptsyntax as rs
import scriptcontext as sc
import Rhino
import json
import re


def is_iterable(item):
    """If list or tuple"""
    return hasattr(item, '__iter__')


def create_tree(t = object):
    from Grasshopper import DataTree
    from Grasshopper.Kernel.Data import GH_Path as Path
    from System import Array

    return DataTree[t]()


def create_path(track):
    from Grasshopper.Kernel.Data import GH_Path
    from System import Array

    return GH_Path(Array[int](track))


def list_to_tree(input, tree, start_path_index=0):
    """Transforms nestings of lists or tuples to a Grasshopper DataTree"""

    def proc(input, tree, track):
        path = create_path(track)

        for i, item in enumerate(input):
            if is_iterable(item):
                track.append(i)
                proc(item, tree, track)
                track.pop()
            else:
                tree.Add(item, path)

    proc(input, tree, [start_path_index])
    return tree


def get_sisufile_path():
    if sisufile:
        return sisufile
    return rs.GetDocumentUserText('sisuSyncFile')
    
def get_sisufile(path):
    try:
        return json.load(open(path))
    except Exception as e:
        print(e)
        return None
    
def get_render_layer_names(sisutask):
    layer = sisutask['layer'][0]
    prefix = '{layer}::'.format(layer=layer) if render_layer_full_path else ''
    return [
        '{prefix}{layer}{suffix}'.format(layer=layer, prefix=prefix, suffix=x['layerSuffix'])
        for x in sisutask['view']
    ]

def get_layer_dimension(sisutask):
    #code = sisutask['code']
    view = sisutask['view']
    if len(view):
        return 2
    return 1

def filter_layer_exist(layer, all_layers):
    if not layer_exist:
        return True
    return layer in all_layers

def main():
    global dimension
    global layers
    global render_layers
    
    doc_layer_names = rs.LayerNames()
    
    layer_filter_re = re.compile(layer_filter if layer_filter else '.*')
    sisufile_path = get_sisufile_path()
    sisufile = get_sisufile(sisufile_path)
    if not sisufile:
        return

    data = sisufile['data']

    sisutasks = [
        x
        for x in data
        if filter_layer_exist(x['layer'][0], doc_layer_names) and layer_filter_re.match(x['layer'][0])
    ]

    dimension = [
        get_layer_dimension(x)
        for x in sisutasks
    ]
    layers = [
        x['layer'][0]
        for x in sisutasks
    ]
    layer_render_names = [
        get_render_layer_names(x)
        for x in sisutasks
    ]
    render_layers = list_to_tree(layer_render_names, create_tree())

sc.doc = Rhino.RhinoDoc.ActiveDoc
main()
sc.doc = ghdoc
# ---------- end python ----------
panel = Panel(python.layers)
panel_2 = Panel(python.dimension)
panel_3 = Panel(python.render_layers)
